# Grasshopper definition Point Attractor - Columm Height.gh (Grasshopper 1.0.7)

# ---- group: Point
pt = ConstructPoint(XCoordinate=Slider(229.647, range=0..320), YCoordinate=Slider(136.471, range=0..320), ZCoordinate=0)

# ---- group: Grid
number_slider = Slider(16, range=0..100)
sqgrid = Square(Plane=PlaneXY(0, 0, 0), Size=Slider(20, range=0..100), ExtentX=number_slider, ExtentY=number_slider)  # -> Cells, flatten(Points)

# ----
dist = Distance(PointA=pt, PointB=sqgrid.Points)
bnd = Bounds(Numbers=dist)

# ---- group: Remap Value
min_value = Slider(1, range=0..1)
max_value = Slider(100, range=0..100)
dom = ConstructDomain(DomainStart=min_value, DomainEnd=max_value)
remap = RemapNumbers(Value=dist, Source=bnd, Target=dom)  # -> Mapped, Clipped
panel = Panel(remap.Mapped)

min_value_2 = Slider(1, range=0..1)
max_value_2 = Slider(9, range=0..10)
dom_2 = ConstructDomain(DomainStart=min_value_2, DomainEnd=max_value_2)
remap_2 = RemapNumbers(Value=dist, Source=bnd, Target=dom_2)  # -> Mapped, Clipped
panel_2 = Panel(remap_2.Mapped)

# ----
gradient = Gradient(
    LowerLimit=Slider(200, range=0..200),
    UpperLimit=Slider(1, range=0..1),
    Parameter=dist,
    stops=[0: RGB(255, 255, 255), 1: RGB(0, 0, 0)])
cir = Circle(Plane=sqgrid.Points, Radius=remap_2.Mapped)
panel_3 = Panel(bnd)
Z = UnitZ(Factor=remap.Mapped)
srf = Surface(cir)
extr = Extrude(Base=srf, Direction=Z)
preview = CustomPreview(Geometry=extr, Material=gradient)
