# Grasshopper definition Point Attractor - Rectangle Rotary - LunchBox Attractor.gh (Grasshopper 1.0.7)
# plug-ins: LunchBox

yz = YZPlane(Origin=Point(0, 0, 0))
number_slider = Slider(40, range=0..100)
rectangle = Rectangle(Plane=yz, XSize=number_slider, YSize=number_slider, Radius=0)  # -> Rectangle, Length

division = Division(A=number_slider, B="2")
pt = ConstructPoint(XCoordinate=0, YCoordinate=division, ZCoordinate=division)

# ---- group: Timer Interval Move
timer = Timer(TimerInterval=100, Target=rec)
rec = DataRecorder("0", DataLimit=-10, RecordData=False)
lng = ListLength(List=rec)
division_2 = Division(A=lng, B="20")
sin = Sine(Value=division_2)
cos = Cosine(Value=division_2)
panel = Panel(sin)
multiplication = Multiplication(A=sin, B="15")
multiplication_2 = Multiplication(A="15", B=cos)
vec = VectorXYZ(XComponent=0, YComponent=multiplication, ZComponent=multiplication_2)  # -> Vector, Length
move = Move(Geometry=pt, Motion=vec.Vector)  # -> Geometry, Transform

# ----
quads = QuadPanels(Surface=rectangle.Rectangle, UDivisions="16", VDivisions="16")  # -> flatten(Panels)
disc = Discontinuity(Curve=quads, Level=1)  # -> Points, Parameters
area = Area(Geometry=quads)  # -> Area, Centroid
scale = Scale(Geometry=quads, Center=area.Centroid, Factor=Slider(0.9, range=0..1))  # -> Geometry, Transform
item = ListItem(List=disc.Points, Index=0, Wrap=True)  # -> Item, Item1, Item2, Item3
attract = Attractor(AttractorPoints=move.Geometry, TargetPoints=area.Centroid, AttractorDomain="0 to 90")  # -> Values, Vectors, Distances
ln = Line(StartPoint=item.Item, EndPoint=item.Item2)  # -> flatten(Line)
graph = GraphMapper(attract.Values, x0=0, x1=90, y0=0, y1=90, container_name="Bezier", cpx=[0, 0.3010581136, 0, 1], cpy=[0, 0, 1, 1])
rotax = RotateAxis(Geometry=scale.Geometry, Angle=degrees(graph), Axis=ln)  # -> Geometry, Transform
