# Grasshopper definition Point Attractor - Rectangle Rotary.gh (Grasshopper 1.0.7)
# plug-ins: LunchBox, Firefly.Core

yz = YZPlane(Origin=Point(0, 0, 0))
number_slider = Slider(40, range=0..100)
rectangle = Rectangle(Plane=yz, XSize=number_slider, YSize=number_slider, Radius=0)  # -> Rectangle, Length

# ---- group: Point
pt = ConstructPoint(XCoordinate=0, YCoordinate=Slider(20, range=0..40), ZCoordinate=Slider(20, range=0..40))

# ---- group: Timer Interval Move
timer = Timer(TimerInterval=100, Target=rec)
rec = DataRecorder("0", DataLimit=-10, RecordData=False)
lng = ListLength(List=rec)
division = Division(A=lng, B="20")
sin = Sine(Value=division)
cos = Cosine(Value=division)
panel = Panel(sin)
multiplication = Multiplication(A=sin, B="15")
multiplication_2 = Multiplication(A="15", B=cos)
vec = VectorXYZ(XComponent=0, YComponent=multiplication, ZComponent=multiplication_2)  # -> Vector, Length
move = Move(Geometry=pt, Motion=vec.Vector)  # -> Geometry, Transform

# ----
quads = QuadPanels(Surface=rectangle.Rectangle, UDivisions="16", VDivisions="16")  # -> flatten(Panels)
disc = Discontinuity(Curve=quads, Level=1)  # -> Points, Parameters
area = Area(Geometry=quads)  # -> Area, Centroid
dist = Distance(PointA=move.Geometry, PointB=area.Centroid)
bnd = Bounds(Numbers=dist)

# ---- group: Remap Value
max_value = Slider(90, range=0..90)
min_value = Slider(1, range=0..1)
dom = ConstructDomain(DomainStart=min_value, DomainEnd=max_value)
remap = RemapNumbers(Value=dist, Source=bnd, Target=dom)  # -> Mapped, Clipped
panel_2 = Panel(remap.Mapped)

# ----
scale = Scale(Geometry=quads, Center=area.Centroid, Factor=Slider(0.9, range=0..1))  # -> Geometry, Transform
item = ListItem(List=disc.Points, Index=0, Wrap=True)  # -> Item, Item1, Item2, Item3
min = Minimum(A=remap.Mapped, B=Slider(50, range=0..100))
ln = Line(StartPoint=item.Item, EndPoint=item.Item2)  # -> flatten(Line)
bnd_2 = Bounds(Numbers=min)
dom_2 = ConstructDomain(DomainStart=Slider(0, range=0..90), DomainEnd=Slider(90, range=0..90))
remap_2 = RemapNumbers(Value=min, Source=bnd_2, Target=dom_2)  # -> Mapped, Clipped
rotax = RotateAxis(Geometry=scale.Geometry, Angle=degrees(remap_2.Mapped), Axis=ln)  # -> Geometry, Transform
panel_3 = Panel(remap_2.Mapped)

# ---- group: Data Analisys
int = Integer(expr("Round(x,0)", panel_3))
partition = PartitionList(List=int, Size="16")
viewer = ParamViewer(partition)
join = TextJoin(Text=partition, Join=",")  # -> flatten(Result)
item_2 = ListItem(List=join, Index="0", Wrap=True)
panel_4 = Panel(item_2)
panel_5 = Panel(join)

# ---- group: Serial Port
ports_available = COMPortsAvailable()
lng_2 = ListLength(List=ports_available)
open_port = OpenClosePort(OpenClosePort=lng_2, PortNumber=ports_available, BaudRate="115200")
write = SerialWriteGeneric(StartWritingValues=lng_2, WriteData=panel_4, PortNumber=ports_available)  # -> ArduinoOutput, StatusMessage
panel_6 = Panel(open_port)
panel_7 = Panel(write.ArduinoOutput)
panel_8 = Panel(write.StatusMessage)
