# Grasshopper definition Webcam to Circle Resize and Rectangle Rotary.gh (Grasshopper 1.0.7)
# plug-ins: Firefly.X, LunchBox

org_x = Panel("0")
org_y = Panel("0")

path = FilePath("D:\@ Drive\@ mkGreen.org\Soft Rhino\Example\rec 160x120.jpg")
load_bitmap = LoadBitmap(FilePathToImageLocation=path)

video_stream = WebCamVideoStream()
saturation = BrightnessAndSaturation(BitmapToModify=video_stream, SaturationMultiplier=Slider(0, range=0..1), BrightnessMultiplier=Slider(1.2, range=0..2))
contrast = Contrast(BitmapToModify=saturation, ContrastMultiplier=Slider(0.65, range=0..1))
painter = BitmapPainter(BitmapToPaint=contrast)

# ---- group: Scale Calculate
info = BitmapInfo(FireflyBitmap=painter)  # -> PixelResolutionInXAxis, PixelResolutionInYAxis
multiplication = Multiplication(A="0.2", B=info.PixelResolutionInXAxis)
multiplication_2 = Multiplication(A="0.2", B=info.PixelResolutionInYAxis)
round = Round(Number=multiplication)  # -> Nearest, Floor, Ceiling
round_2 = Round(Number=multiplication_2)  # -> Nearest, Floor, Ceiling

# ----
size_of_cell = Panel("10")
panel = Panel(round.Floor)
panel_2 = Panel(round_2.Floor)
pt = ConstructPoint(XCoordinate=org_x, YCoordinate=org_y, ZCoordinate="50")
xy = XYPlane(Origin=pt)
multiplication_3 = Multiplication(A=size_of_cell, B=panel)
multiplication_4 = Multiplication(A=size_of_cell, B=panel_2)
rectangle = Rectangle(Plane=xy, XSize=multiplication_3, YSize=multiplication_4, Radius=0)  # -> Rectangle, Length
quads = QuadPanels(Surface=rectangle.Rectangle, UDivisions=panel, VDivisions=panel_2)  # -> flatten(Panels)
Z = UnitZ(Factor="-60")
srf = Surface(rectangle.Rectangle)
move = Move(Geometry=srf, Motion=Z)  # -> Geometry, Transform
area = Area(Geometry=quads)  # -> Area, Centroid
disc = Discontinuity(Curve=quads, Level=1)  # -> Points, Parameters
col = Colour(RGB(255, 255, 255))
preview = CustomPreview(Geometry=move.Geometry, Material=col)

pdecon = Deconstruct(Point=area.Centroid)  # -> XComponent, YComponent, ZComponent; disabled
org_x_2 = Integer(org_x)  # disabled
org_y_2 = Integer(org_y)  # disabled
subtraction = Subtraction(A=pdecon.XComponent, B=org_x_2)  # disabled
subtraction_2 = Subtraction(A=pdecon.YComponent, B=org_y_2)  # disabled
pt_2 = ConstructPoint(XCoordinate=subtraction, YCoordinate=subtraction_2, ZCoordinate=0)  # disabled
sample = BitmapSampler(BitmapToModify=painter, PointToSample=pt_2, BitmapToModify_2=painter, PointToSample_2=pt_2, bitmap_filter=7)  # -> reverse(SampledImageData), reverse(SampledImageData_2); disabled
panel_3 = Panel(sample.SampledImageData_2)  # disabled

# ---- group: Bitmap Resize & Sampler
resize = ResizeBitmap(BitmapToModify=painter, NewResolutionInXAxis=panel, NewResolutionInYAxis=panel_2)
decompose = BitmapDecompose(BitmapToDecompose=resize)  # -> RedChannel, GreenChannel, BlueChannel, AlphaChannel, XResolution, YResolution
bnd = Bounds(Numbers=decompose.RedChannel)
remap = RemapNumbers(Value=decompose.RedChannel, Source=bnd, Target="0.0 to 1.0")  # -> Mapped, Clipped
matrix = ConstructMatrix(Rows=decompose.YResolution, Columns=decompose.XResolution, Values=remap.Mapped)
transpose = TransposeMatrix(Matrix=matrix)
dematrix = DeconstructMatrix(Matrix=transpose)  # -> Rows, Columns, flatten(Values)

# ----
mesh = MeshFromImage(Bmp=painter, Sx=multiplication_3, Sy=multiplication_4, Z=1, C=True)

# ---- group: Circle Scale
panel_4 = Panel(area.Centroid)
int = Integer(expr("(X/2)", size_of_cell))
graph_mapper = GraphMapper(
    dematrix.Values,
    x0=0,
    x1=1,
    y0=0,
    y1=1,
    container_name="Bezier",
    cpx=[0, 0.3213820159, 0.6164578795, 1],
    cpy=[1, 0.7144775391, 0.4485445619, 0.0988214612])
multiplication_5 = Multiplication(A="0.9", B=int)
circle = Circle(Plane=panel_4, Radius=multiplication_5)
scale = Scale(Geometry=circle, Center=panel_4, Factor=graph_mapper)  # -> Geometry, Transform
srf_2 = Surface(scale.Geometry)

# ---- group: Rectangle Rotary
graph_mapper_2 = GraphMapper(dematrix.Values, x0=0, x1=1, y0=0, y1=1, container_name="Bezier", cpx=[0, 0.25, 0.75, 1], cpy=[0, 0.25, 0.75, 1])
scale_2 = Scale(Geometry=quads, Center=area.Centroid, Factor="0.9")  # -> Geometry, Transform
item = ListItem(List=disc.Points, Index=0, Wrap=True)  # -> Item, Item1, Item2, Item3
bnd_2 = Bounds(Numbers=graph_mapper_2)
ln = Line(StartPoint=item.Item, EndPoint=item.Item2)  # -> flatten(Line)
remap_2 = RemapNumbers(Value=graph_mapper_2, Source=bnd_2, Target="0 to 90")  # -> Mapped, Clipped
rotax = RotateAxis(Geometry=scale_2.Geometry, Angle=degrees(remap_2.Mapped), Axis=ln)  # -> Geometry, Transform
